# Grasshopper definition UDP_receiver.gh (Grasshopper 1.0.8)
# plug-ins: gHowl

network_source = NetworkSource()  # -> NetworkAdapterIsUp, AdapterProperties, LocalIpAddress
panel = Panel(network_source.LocalIpAddress)
udp_receiver = UDPReceiver(Address=network_source.LocalIpAddress, Port="5000", Pattern=0)  # -> Info, Data
panel_2 = Panel(udp_receiver.Data)
cluster = Cluster_4(text=udp_receiver.Data)  # -> list, list_2
# freq: 每10秒采样一次
met = Panel(cluster.list_2)
pow = Panel(cluster.list)

# ==== cluster Cluster_4
text = ClusterInput()
panel = Panel("""[
]""")
text_split = TextSplit(Text=text, Separators=panel)
cluster = Cluster_2(list=text_split)
cluster_2 = Cluster_3(list=text_split)
list = ClusterOutput(cluster)
list_2 = ClusterOutput(cluster_2)

# ==== cluster Cluster_2
power_data = Panel("1")
list = ClusterInput()
list_item = ListItem(List=list, Index=power_data, Wrap=True)
text_split = TextSplit(Text=list_item, Separators=", ")
cluster = Cluster(list=text_split, text=text_split)  # -> flatten(list_2)
list_2 = ClusterOutput(cluster)

# ==== cluster Cluster_3
performance_metric = Panel("3")
list = ClusterInput()
list_item = ListItem(List=list, Index=performance_metric, Wrap=True)
text_split = TextSplit(Text=list_item, Separators=" , ")
去除empty = Cluster(list=text_split, text=text_split)
list_2 = ClusterOutput(去除empty)

# ==== cluster Cluster
text = ClusterInput()
list = ClusterInput()
text_length = TextLength(Text=text)
larger_than = LargerThan(FirstNumber=text_length, SecondNumber=0)  # -> LargerThan, OrEqualTo
cull_pattern = CullPattern(List=list, CullPattern=larger_than.LargerThan)
list_2 = ClusterOutput(cull_pattern)
